# Dynamo graph Cloud Point Code.dyn "Ejercicio 12" (Dynamo 2.16.2.5624)

number_slider = DoubleSlider(5, range=0..5 step 0.5)
python_script = Python(IN[0]=number_slider)  # CPython3
# ---------- python_script.python (126 lines) ----------
import clr
import System

clr.AddReference('RevitAPI')
from Autodesk.Revit.DB import *
from Autodesk.Revit.DB.Structure import *

clr.AddReference('RevitAPIUI')
from Autodesk.Revit.UI import *

clr.AddReference('System')
from System.Collections.Generic import List

clr.AddReference('RevitNodes')
import Revit
clr.ImportExtensions(Revit.GeometryConversion)
clr.ImportExtensions(Revit.Elements)

clr.AddReference('RevitServices')
import RevitServices
from RevitServices.Persistence import DocumentManager
from RevitServices.Transactions import TransactionManager

import sys
sys.path.append(r'C:\Users\EXCELTIC427\Documents\FUNCIONES DYNAMO')

doc = DocumentManager.Instance.CurrentDBDocument
uidoc=DocumentManager.Instance.CurrentUIApplication.ActiveUIDocument


def  enumerados_familias_vista():
    #obtenemos los valores de enumerado de los tipos de vista, así como sus nombres 
    #el resultado de tipos es un integral, y el de names un string. 
    tipos = System.Enum.GetValues(ViewFamily)
    nombres = System.Enum.GetNames(ViewFamily)
    
    claves = [str(x) for x in tipos]
    #creamos un diccionario asignando cada clave al nombre correspondiente
    return dict(zip(claves, nombres))
    

def tipo_vista_nombre_familia(nombre):
    """
    Uso:
        Seleccionar tipo de familia devista segun 
        su nombre
    Input:
        Nombre de tipo de familia de vista <str>
    Output:
        Tipo de familia de vista <ViewFamilyType>
    """
    #creamos un colector con todas las familias de vista 
    tiposFamiliaVistas = FilteredElementCollector(doc).OfClass(ViewFamilyType).ToElements()

    #si el lenguaje es cpython, creamos una lista con los elementos que coincidan con el nombre de busqueda de la función. solo nos hace falta quedarnos con un elemento. 
    if sys.implementation.name == 'cpython':
        tipoVista = [x for x in tiposFamiliaVistas if enumerados_familias_vista()[str(x.ViewFamily)] == nombre][0]
    

    else:
        tipoVista = [x for x in tiposFamiliaVistas if str(x.ViewFamily) == nombre][0]
    
    return tipoVista
    

sectionBoxSize = UnwrapElement(IN[0])

#a través de un colector, creamos una variable con la(s) nube(s) de puntos
pointclouds = FilteredElementCollector(doc).OfClass(PointCloudInstance).ToElements()

if pointclouds:
    scanPoints = []
    for pointcloud in pointclouds:
        #podemos usar el comando "GetScans" para obtener los diferentes escaneos. 
        scans = pointcloud.GetScans()
        for s in scans:
            #el comando "GetScanOrigin" nos ayuda a encontrar el punto de origen del escaneo. 
            scanPoints.append(pointcloud.GetScanOrigin(s))
    
    #utilizamos la funcion del principio para encontrar el tipo de vista tridimensional     
    tipoVista = tipo_vista_nombre_familia('ThreeDimensional')
    #determinamos si el numero de puntos del escaneo tiene 1 cifra, 2, 3...  
    numPuntos = len(str(len(scanPoints)))
    #creamos una lista vacía que iremos llenando con tantas vistas como puntos de vista haya 
    vistas = []
    
    TransactionManager.Instance.EnsureInTransaction(doc)
    exito=0
    for i in range(len(scanPoints)):
        try:
            #crearemos tantas vistas como número de puntos de escaneo
            vista = View3D.CreateIsometric(doc, tipoVista.Id)
            vistas.append(vista)
            #creamos un bounding box
            bBox = BoundingBoxXYZ() 
            #el punto mínimo es el punto de origen y le añadimos la mitad del tamaño de la caja, pero en negativo. Al punto máximo habrá que añadirselo en positivo.         
            pMin = scanPoints[i].Add(XYZ(-sectionBoxSize/2, -sectionBoxSize/2, -sectionBoxSize/2))
            pMax = scanPoints[i].Add(XYZ(sectionBoxSize/2, sectionBoxSize/2, sectionBoxSize/2))
            #seteamos el punto mínimo y el máximo 
            bBox.Min = pMin
            bBox.Max = pMax
            
            #le añadimos una section box con nuestra bounding box a la vista que estamos creando 
            vista.SetSectionBox(bBox)
            
            #para saber cuantos ceros poner al nombre, determinamos que el número de ceros depende de cuantas cifras tenga nuestro numero de puntos (1 cifra, 2 cifras...) y del número de rango en el que estemos. Supongamos que tenemos 20 escaneos (2 cifras) y estamos en el escaneo número 5. 2-1=1 cero. Si estuvieramos en el escaneo 12 (2 cifras) 2-2=0 ceros. 
            zeros = numPuntos - len(str(i))
            
            #aplicamos el nombre 
            vista.Name = 'EDITECA - PointCloudScan_' + ('0'*zeros)+ str(i)
            exito+=1
        except: 
            pass
    
    TransactionManager.Instance.TransactionTaskDone()
    mensajeSalida = 'Se han creado {} vistas 3D para los puntos de escaneo'.format(exito)



else:
    mensajeSalida = 'No existen instancias de NDP en el documento'




OUT = mensajeSalida
# ----------------------------------------
python_script_2 = Python()  # CPython3
# ---------- python_script_2.python (35 lines) ----------
import clr
import System

clr.AddReference('RevitAPI')
from Autodesk.Revit.DB import *
from Autodesk.Revit.DB.Structure import *

clr.AddReference('RevitAPIUI')
from Autodesk.Revit.UI import *

clr.AddReference('System')
from System.Collections.Generic import List

clr.AddReference('RevitNodes')
import Revit
clr.ImportExtensions(Revit.GeometryConversion)
clr.ImportExtensions(Revit.Elements)

clr.AddReference('RevitServices')
import RevitServices
from RevitServices.Persistence import DocumentManager
from RevitServices.Transactions import TransactionManager

import sys
sys.path.append(r'C:\Users\EXCELTIC427\Documents\FUNCIONES DYNAMO')

doc = DocumentManager.Instance.CurrentDBDocument
uidoc=DocumentManager.Instance.CurrentUIApplication.ActiveUIDocument

tipos = System.Enum.GetValues(ViewFamily)
nombres = System.Enum.GetNames(ViewFamily)
    


OUT =type(tipos[6]), type(nombres[6])
# ----------------------------------------
